# Grasshopper definition Random_Walk.gh (Grasshopper 1.0.7)
# plug-ins: Human

starting_point_x_y_z_coordinate = Panel("""0
0
0""")  # disabled
number_slider = Slider(102, range=0..1000)  # disabled
number_of_steps = Panel("1000")  # disabled
simple_random_walk = GhPythonScript(n=number_of_steps, p=starting_point_x_y_z_coordinate)  # -> l; inputs n: Int32, p: list of Int32; disabled
# ---------- simple_random_walk: Python ----------
"""Provides a scripting component.
Remember to change type hint (Python only)
    Inputs:
        n: Number of steps (int)
        p: (Randomly Walking) Point (int list)
    Output:
        l: Point List (list of int list)"""

__author__ = "Zoe De Simone after Bill Xu's 2D implementation"
__version__ = "2020.02.15"

import rhinoscriptsyntax as rs
import random as rand
import ghpythonlib.treehelpers as th

# Define our Step Set (List here):
steplist = ((0,0,1), (0,1,0), (1,0,0), (0,0,-1), (0,-1,0), (-1,0,0))

# Define our Point List l
l = []

# Start from a given point p (e.g., (0,0,0))
# We have p as input value

# Add p to point list l
l.append(p)

# Repeat steps below for given times n
for i in range(n):

    # Randomly selected a step s from step set 
    # Generate a rand int from 0 to 5
    r = rand.randint(0,len(steplist)-1)
    # Pick r-th element from our steplist
    step = steplist[r]
    
    # Move and Update P according to s
    p = [p[0]+step[0], p[1]+step[1],p[2]+step[2]]
    
    # Add new p to l
    l.append(p)
    
#Convert Python tree to GH tree (Python only)
l=th.list_to_tree(l)
# ---------- end simple_random_walk ----------
panel = Panel("0")  # disabled
panel_2 = Panel("1")  # disabled
panel_3 = Panel("2")  # disabled
item = ListItem(List=simple_random_walk, Index=panel, Wrap=True)  # disabled
item_2 = ListItem(List=simple_random_walk, Index=panel_2, Wrap=True)  # disabled
item_3 = ListItem(List=simple_random_walk, Index=panel_3, Wrap=True)  # disabled
lng = ListLength(List=flatten(item_3))  # disabled
pt = ConstructPoint(XCoordinate=item, YCoordinate=item_2, ZCoordinate=item_3)  # -> flatten(Point); disabled
panel_4 = Panel(lng)  # disabled
dom = ConstructDomain(DomainStart=0, DomainEnd=lng)  # disabled
series = Series(Start=0, Step=1, Count=lng)  # disabled
gradient = Gradient(LowerLimit=0, UpperLimit=lng, Parameter=series, stops=[0: RGB(0, 191, 255), 1: RGB(255, 0, 255)])  # disabled
gradient_2 = Gradient(LowerLimit=0, UpperLimit=lng, Parameter=series, stops=[0: RGB(192, 255, 255), 1: RGB(0, 0, 192)])  # disabled
swatch = ColourSwatch(SwatchColor=RGB(191, 191, 191))  # disabled
shift = ShiftList(List=pt, Shift=-1, Wrap=False)  # disabled
shift_2 = ShiftList(List=pt, Shift=1, Wrap=False)  # disabled
tag = TextTag(Location=pt, Text=series, Colour=gradient_2)  # disabled
ln = Line(StartPoint=shift_2, EndPoint=shift)  # disabled
preview = CustomPreview(Geometry=pt, Material=gradient)  # disabled
preview_2 = CustomPreview(Geometry=ln, Material=gradient)  # disabled

starting_point_x_and_y_coordinate = Panel("""0
0""")  # disabled
number_of_steps_2 = Panel("2500")  # disabled
simple_random_walk_2 = GhPythonScript(n=number_of_steps_2, p=starting_point_x_and_y_coordinate)  # -> l; inputs n: Int32, p: list of Int32; disabled
# ---------- simple_random_walk_2: Python ----------
"""Provides a scripting component.
Remember to change type hint (Python only)
    Inputs:
        n: Number of steps (int)
        p: (Randomly Walking) Point (int list)
    Output:
        l: Point List (list of int list)"""

__author__ = "Bill Xu"
__version__ = "2020.02.11"

import rhinoscriptsyntax as rs
import random as rand
import ghpythonlib.treehelpers as th

# Define our Step Set (List here):
steplist = ((0,1), (1,0), (0,-1), (-1,0))

# Define our Point List l
l = []

# Start from a given point p (e.g., (0,0))
# We have p as input value

# Add p to point list l
l.append(p)

# Repeat steps below for given times n
for i in range(n):

    # Randomly selected a step s from step set 
    # Generate a rand int from 0 to 3
    r = rand.randint(0,len(steplist)-1)
    # Pick r-th element from our steplist
    step = steplist[r]
    
    # Move and Update P according to s
    p = [p[0]+step[0], p[1]+step[1]]
    
    # Add new p to l
    l.append(p)
    
#Convert Python tree to GH tree (Python only)
l=th.list_to_tree(l)
# ---------- end simple_random_walk_2 ----------
panel_5 = Panel("0")  # disabled
panel_6 = Panel("1")  # disabled
item_4 = ListItem(List=simple_random_walk_2, Index=panel_5, Wrap=True)  # disabled
item_5 = ListItem(List=simple_random_walk_2, Index=panel_6, Wrap=True)  # disabled
pt_2 = ConstructPoint(XCoordinate=item_4, YCoordinate=item_5, ZCoordinate=0)  # -> flatten(Point); disabled
shift_3 = ShiftList(List=pt_2, Shift=-1, Wrap=False)  # disabled
shift_4 = ShiftList(List=pt_2, Shift=1, Wrap=False)  # disabled
lng_2 = ListLength(List=flatten(item_5))  # disabled
dom_2 = ConstructDomain(DomainStart=0, DomainEnd=lng_2)  # disabled
ln_2 = Line(StartPoint=shift_4, EndPoint=shift_3)  # disabled
series_2 = Series(Start=0, Step=1, Count=lng_2)  # disabled
gradient_3 = Gradient(LowerLimit=0, UpperLimit=lng_2, Parameter=series_2, stops=[0: RGB(192, 255, 255), 1: RGB(0, 0, 192)])  # disabled
tag_2 = TextTag(Location=pt_2, Text=series_2, Colour=gradient_3)  # disabled
preview_3 = CustomPreview(Geometry=[pt_2, ln_2], Material=gradient_3)  # disabled

item_6 = ListItem(List=pt, Index=0, Wrap=True)  # -> Item1, Item; disabled
number_slider_2 = Slider(0.47, range=0..1)  # disabled
panel_7 = Panel("Helvetica")  # disabled
swatch_2 = ColourSwatch(SwatchColor=RGB(255, 255, 255))  # disabled
panel_8 = Panel("END")  # disabled
panel_9 = Panel("START")  # disabled
screentext = ScreenOrientedText(
    Text=panel_8,
    Font=panel_7,
    Justification=2,
    Location=item_6.Item1,
    SizeFactor=number_slider_2,
    Color=swatch_2,
    Depth=1,
    Absolute=True)  # disabled
screentext_2 = ScreenOrientedText(
    Text=panel_9,
    Font=panel_7,
    Justification=2,
    Location=item_6.Item,
    SizeFactor=number_slider_2,
    Color=swatch_2,
    Depth=1,
    Absolute=True)  # disabled

item_7 = ListItem(List=pt_2, Index=0, Wrap=True)  # -> Item1, Item; disabled
number_slider_3 = Slider(0.9, range=0..1)  # disabled
panel_10 = Panel("Helvetica")  # disabled
swatch_3 = ColourSwatch(SwatchColor=RGB(255, 255, 255))  # disabled
panel_11 = Panel("END")  # disabled
panel_12 = Panel("START")  # disabled
screentext_3 = ScreenOrientedText(
    Text=panel_11,
    Font=panel_10,
    Justification=2,
    Location=item_7.Item1,
    SizeFactor=number_slider_3,
    Color=swatch_3,
    Depth=1,
    Absolute=True)  # disabled
screentext_4 = ScreenOrientedText(
    Text=panel_12,
    Font=panel_10,
    Justification=2,
    Location=item_7.Item,
    SizeFactor=number_slider_3,
    Color=swatch_3,
    Depth=1,
    Absolute=True)  # disabled
